# Grasshopper definition building_generator.gh (Grasshopper 1.0.7)

crv = Curve(<curve referenced from the Rhino model>)
crv_2 = Curve(crv)
base_rotate_angle = Slider(0, range=-2..2)
top_rotate_angle = Slider(-0.1, range=-2..2)
base_scale_factor = Slider(1, range=0.5..1.5)
top_scale_factor = Slider(1.4, range=0.5..1.5)
floor_height = Slider(4.5, range=4..6)
building_height = Slider(25, range=20..30)
area = Area(Geometry=crv_2)  # -> Area, Centroid
topoly = CurveToPolyline(Curve=crv_2, ToleranceDistance=0, ToleranceAngle=0)  # -> Polyline, Segments
panel = Panel(area.Area)
pcen = PolygonCenter(Polyline=topoly.Polyline)  # -> CenterV, CenterE, CenterA
multiplication = Multiplication(A=building_height, B=floor_height)
pt = Point(pcen.CenterV)
Z = UnitZ(Factor=multiplication)
scale = Scale(Geometry=crv_2, Center=pt, Factor=base_scale_factor)  # -> Geometry, Transform
pdecon = Deconstruct(Point=pt)  # -> XComponent, YComponent, ZComponent
move = Move(Geometry=crv_2, Motion=Z)  # -> Geometry, Transform
pt_2 = ConstructPoint(XCoordinate=pdecon.XComponent, YCoordinate=pdecon.YComponent, ZCoordinate=multiplication)
rotate = Rotate(Geometry=scale.Geometry, Angle=base_rotate_angle, Plane=pt)  # -> Geometry, Transform
scale_2 = Scale(Geometry=move.Geometry, Center=pt_2, Factor=top_scale_factor)  # -> Geometry, Transform
rotate_2 = Rotate(Geometry=scale_2.Geometry, Angle=top_rotate_angle, Plane=pt_2)  # -> Geometry, Transform
loft = Loft(
    Curves=[rotate_2.Geometry, rotate.Geometry],
    Options={Adjust=False, Closed=False, LoftEnds=0, LoftSimp=0, LoftType=0, Rebuild=10, Refit=0.01})
cap = CapHoles(Brep=loft)
panel_2 = Panel(cap)
contour = Contour(Shape=cap, Point=Point(0, 0, 0), Direction=Vector(0, 0, 1), Distance=floor_height)  # -> flatten(Contours)
split = SplitList(List=contour, Index=building_height)  # -> ListA, ListB
preview = CustomPreview(Geometry=cap, Material=ColourSwatch(SwatchColor=RGB(176, 255, 229)))
area_2 = Area(Geometry=split.ListA)  # -> Area, Centroid
ma = MassAddition(Input=area_2.Area)  # -> Result, PartialResults
panel_3 = Panel(ma.Result)
panel_4 = Panel(area_2.Area)
